# Grasshopper definition MYP_280818_v1.0.gh (Grasshopper 0.9.76)
# plug-ins: Heteroptera, Ivy

# ---- group: box
number_slider = Slider(100, range=0..100)
number_slider_2 = Slider(1, range=0..10)
# Semaine d'Ouverture 3A GCC
# Atelier MakeYourPulse!
# 17/09/18 - 21/09/18
# contributors: a. rigobello
number_slider_3 = Slider(5, range=0..10)
pt = ConstructPoint(XCoordinate=0, YCoordinate=0, ZCoordinate=Slider(40, range=0..1000))
neg = Negative(Value=number_slider)
dom = ConstructDomain(DomainStart=number_slider, DomainEnd=neg)
xy = XYPlane(Origin=pt)
number_slider_4 = Slider(100, range=0..100)
msphere = MeshSphere(Base=xy, Radius=Slider(75, range=0..1000), UCount=number_slider_3, VCount=Slider(14, range=0..100))
rectangle = Rectangle(Plane=PlaneXY(0, 0, 0), XSize=dom, YSize=dom, Radius=0)  # -> Rectangle, Length
mplane = MeshPlane(Boundary=rectangle.Rectangle, WidthCount=number_slider_2, HeightCount=number_slider_2)  # -> Mesh, Area
pt_2 = ConstructPoint(XCoordinate=0, YCoordinate=0, ZCoordinate=Slider(100, range=0..1000))
neg_2 = Negative(Value=number_slider_4)
xy_2 = XYPlane(Origin=pt_2)
dom_2 = ConstructDomain(DomainStart=number_slider_4, DomainEnd=neg_2)
msplit = MeshSplit(Mesh=mplane.Mesh, Splitters=msphere)
msplit_2 = MeshSplit(Mesh=msphere, Splitters=mplane.Mesh)
rectangle_2 = Rectangle(Plane=xy_2, XSize=dom_2, YSize=dom_2, Radius=0)  # -> Rectangle, Length
item = ListItem(List=msplit_2, Index=0, Wrap=True)
mplane_2 = MeshPlane(Boundary=rectangle_2.Rectangle, WidthCount=number_slider_2, HeightCount=number_slider_2)  # -> Mesh, Area
quad = Quadrangulate(Mesh=item, Angle=0.03490658504, Ratio=0.875)  # -> Mesh, Count
msplit_3 = MeshSplit(Mesh=mplane_2.Mesh, Splitters=quad.Mesh)
msplit_4 = MeshSplit(Mesh=quad.Mesh, Splitters=mplane_2.Mesh)
item_2 = ListItem(List=msplit_4, Index=0, Wrap=True)  # -> Item, Item1
item_3 = ListItem(List=msplit, Index=0, Wrap=True)  # -> Item, Item1
item_4 = ListItem(List=msplit_3, Index=0, Wrap=True)  # -> Item, Item1
quad_2 = Quadrangulate(Mesh=item_2.Item1, Angle=0.03490658504, Ratio=0.875)  # -> Mesh, Count

# ----
medges = MeshEdges(Mesh=item_4.Item1)  # -> NakedEdges, InteriorEdges, NonManifoldEdges
medges_2 = MeshEdges(Mesh=item_3.Item1)  # -> NakedEdges, InteriorEdges, NonManifoldEdges
crv = Curve(medges.NakedEdges)
crv_2 = Curve(medges_2.NakedEdges)
boundary = BoundarySurfaces(Edges=crv_2)

# ---- group: unroll the mesh
faweight = FaceAngleEdgeWeight(MeshGraph=quad_2.Mesh)
edges = GraphEdges(MeshGraph=faweight)  # -> MeshId, GraphEdge, TopoEdge, Weight, Nodes, Angle, Bend
expression = Expression(x=edges.Weight, Expression="1-x")  # -> flatten(R)
cedgeweight = CustomEdgeWeight(MeshGraph=faweight, Weights=flatten(edges.Weight))
mstd = MSTDjikstra(MeshGraph=cedgeweight)
met = EdgeTypes(MeshGraph=mstd)  # -> GraphEdges, simplify(flatten(CutEdges))
int = Integer(met.CutEdges)
cull_duplicate_values = CSharpScript(x=met.CutEdges)  # -> out, A; inputs x: list of Int32; disabled
# ---------- cull_duplicate_values: C# ----------
    HashSet<int> singular = new HashSet<int>();
    foreach (int i in x)
    {
      singular.Add(i);

    }
    A = singular.ToList();
# ---------- end cull_duplicate_values ----------
thin = ThinMesh(MeshGraph=mstd, Coefficient=Slider(0.9, range=0..1))  # -> OrigGraph, Mesh, ThinGraph
mguroll = MeshGraphUnroll(MeshGraph=mstd, StartFace=-1, UnrollPlane=PlaneXY(0, 0, 0))  # -> Mesh, SplitMeshgraphs, SplitFlatGraphs, UnrollEdgeSplits
sflp = SimpleFlap(
    MeshGraph=cedgeweight,
    Width=Slider(5, range=0..10),
    Bevel=Slider(2, range=0..10),
    Double=Toggle(False),
    MeshEdgeIndex=int)
gate = StreamGate(Data=sflp, PassingSwitch=Toggle(True))
number_slider_5 = Slider(51, range=0..100)
flatfab = FlatFabrication(
    SplitMeshgraphs=mguroll.SplitMeshgraphs,
    SplitFlatGraphs=mguroll.SplitFlatGraphs,
    Flaps=gate,
    PieceLocation=PlaneXY(0, 0, 0),
    TextOffset=0.1)  # -> CutLines, FoldInLines, FoldOutLines, FlatLines, Text, PlaceHolders, InNodeCurves
piece_arangement = ArangeFlatParts(
    P=PlaneXY(58.21205207, -315.4537681, 0),
    sx=number_slider_5,
    sy=number_slider_5,
    rows=Slider(3, range=0..10),
    graph=mguroll.SplitFlatGraphs,
    cut=flatfab.CutLines,
    foldin=flatfab.FoldInLines,
    foldout=flatfab.FoldOutLines,
    flat=flatfab.FlatLines,
    place_holders=flatfab.PlaceHolders)  # -> mesh_2, cut_2, foldin_2, foldout_2, flat_2, position
pshift = ShiftPaths(Data=flatfab.Text, Offset=-1)
crv_3 = Curve(piece_arangement.foldout_2)
crv_4 = Curve(piece_arangement.flat_2)

# ---- group: pot_1
partition = PartitionList(List=piece_arangement.position, Size=Slider(3, range=0..10))
item_5 = ListItem(List=simplify(partition), Index=0, Wrap=True)  # -> flatten(Item), flatten(Item1)
number_slider_6 = Slider(17, range=0..100)
item_6 = ListItem(List=item_5.Item1, Index=Slider(17, range=0..100), Wrap=True)
division = Division(A=number_slider_6, B=2)
cir = Circle(Plane=item_6, Radius=division)

# ---- group: pot_2
partition_2 = PartitionList(List=piece_arangement.position, Size=Slider(3, range=0..10))
item_7 = ListItem(List=simplify(partition_2), Index=0, Wrap=True)  # -> flatten(Item), flatten(Item1), flatten(Item2)
item_8 = ListItem(List=item_7.Item2, Index=Slider(48, range=0..100), Wrap=True)
division_2 = Division(A=number_slider_6, B=2)
cir_2 = Circle(Plane=item_8, Radius=division_2)

# ---- group: joystick
partition_3 = PartitionList(List=piece_arangement.position, Size=Slider(3, range=0..10))
item_9 = ListItem(List=simplify(partition_3), Index=0, Wrap=True)  # -> flatten(Item)
item_10 = ListItem(List=item_9, Index=Slider(16, range=0..100), Wrap=True)
division_3 = Division(A=Slider(25, range=0..100), B=2)
cir_3 = Circle(Plane=item_10, Radius=division_3)

# ---- group: jack3.5
partition_4 = PartitionList(List=piece_arangement.position, Size=Slider(3, range=0..10))
item_11 = ListItem(List=simplify(partition_4), Index=0, Wrap=True)  # -> flatten(Item)
number_slider_7 = Slider(6, range=0..100)
item_12 = ListItem(List=item_11, Index=Slider(21, range=0..100), Wrap=True)
division_4 = Division(A=number_slider_7, B=2)
cir_4 = Circle(Plane=item_12, Radius=division_4)

# ---- group: switch
partition_5 = PartitionList(List=piece_arangement.position, Size=Slider(3, range=0..10))
item_13 = ListItem(List=simplify(partition_5), Index=0, Wrap=True)  # -> flatten(Item), flatten(Item1)
item_14 = ListItem(List=item_13.Item1, Index=Slider(56, range=0..100), Wrap=True)
division_5 = Division(A=number_slider_7, B=2)
cir_5 = Circle(Plane=item_14, Radius=division_5)

# ----
number_slider_8 = Slider(0.02, range=0..1)  # disabled
end = EndPoints(Curve=crv_3)  # -> Start, End; disabled
Y = UnitY(Factor=1)  # disabled
vec2pt = Vector2Pt(PointA=end.Start, PointB=end.End, Unitize=False)  # -> Vector, Length; disabled
neg_3 = Negative(Value=number_slider_8)  # disabled
dprod = DotProduct(VectorA=Y, VectorB=vec2pt.Vector, Unitize=False)  # disabled
larger = LargerThan(FirstNumber=dprod, SecondNumber=neg_3)  # -> LargerThan, OrEqualTo; disabled
number_slider_9 = Slider(23.2, range=0..100)  # disabled
number_slider_10 = Slider(46.92, range=0..100)  # disabled
dispatch = Dispatch(List=crv_3, DispatchPattern=larger.OrEqualTo)  # -> ListA, ListB; disabled
crv_5 = Curve(dispatch.ListB)  # disabled
ext = ExtendCurve(Curve=crv_5, Type=0, Start=number_slider_9, End=number_slider_10)  # disabled

# ----
# text to engrave
number_slider_11 = Slider(2.43, range=0..10)
tag = TextTag3D(Location=piece_arangement.position, Text=pshift, Size=number_slider_11, Justification=5)

crv_6 = Curve(piece_arangement.cut_2)

# ----
# inner cuttings
merge = Merge(Data1=cir_3, Data2=cir, Data3=cir_2, Data4=cir_4, Data5=cir_5)

# ----
# folding lines
merge_2 = Merge(Data2=crv_3, Data3=flatten(crv_4), Data4=ext)

explode = Explode(Curve=piece_arangement.cut_2, Recursive=True)  # -> flatten(Segments), flatten(Vertices)
pdecon = Deconstruct(Point=explode.Vertices)  # -> XComponent, YComponent, ZComponent
pdecon_2 = Deconstruct(Point=explode.Vertices)  # -> XComponent, YComponent, ZComponent
bnd = Bounds(Numbers=pdecon.XComponent)
bnd_2 = Bounds(Numbers=pdecon.YComponent)
dedomain = DeconstructDomain(Domain=bnd)  # -> Start, End
dedomain_2 = DeconstructDomain(Domain=bnd_2)  # -> Start, End
pt_3 = ConstructPoint(XCoordinate=dedomain.Start, YCoordinate=dedomain_2.Start, ZCoordinate=0)
pt_4 = ConstructPoint(XCoordinate=dedomain.End, YCoordinate=dedomain_2.End, ZCoordinate=0)
equals = Equality(FirstNumber=pdecon_2.XComponent, SecondNumber=dedomain.Start)  # -> Equality, Inequality
rec_2pt = Rectangle2Pt(Plane=PlaneXY(0, 0, 0), PointA=pt_3, PointB=pt_4, Radius=0)  # -> Rectangle, Length
dispatch_2 = Dispatch(List=explode.Vertices, DispatchPattern=equals.Equality)  # -> ListA, ListB
drec = DeconstuctRectangle(Rectangle=rec_2pt.Rectangle)  # -> BasePlane, XInterval, YInterval
item_15 = ListItem(List=dispatch_2.ListA, Index=0, Wrap=True)  # -> Item, Item1
dedomain_3 = DeconstructDomain(Domain=drec.YInterval)  # -> Start, End
dedomain_4 = DeconstructDomain(Domain=drec.XInterval)  # -> Start, End
pt_5 = ConstructPoint(XCoordinate=dedomain_4.Start, YCoordinate=dedomain_3.Start, ZCoordinate=0)
pdecon_3 = Deconstruct(Point=item_15.Item1)  # -> XComponent, YComponent, ZComponent
pdecon_4 = Deconstruct(Point=item_15.Item)  # -> XComponent, YComponent, ZComponent
pt_6 = ConstructPoint(XCoordinate=dedomain_4.Start, YCoordinate=dedomain_3.End, ZCoordinate=0)
addition = Addition(A=dedomain_3.End, B=pdecon_3.YComponent)
addition_2 = Addition(A=pdecon_4.YComponent, B=pdecon_3.YComponent)
addition_3 = Addition(A=pdecon_4.YComponent, B=dedomain_3.Start)
division_6 = Division(A=addition, B=Slider(2, range=0..10))
division_7 = Division(A=addition_2, B=Slider(2, range=0..10))
division_8 = Division(A=addition_3, B=Slider(2, range=0..10))
explode_2 = Explode(Curve=rec_2pt.Rectangle, Recursive=True)  # -> Segments, Vertices
item_16 = ListItem(List=explode_2.Segments, Index=0, Wrap=True)  # -> Item, Item1, Item2

# ---- group: x
subtraction = Subtraction(A=dedomain_4.Start, B=Slider(15, range=0..100))

# ----
pt_7 = ConstructPoint(XCoordinate=subtraction, YCoordinate=division_6, ZCoordinate=0)
pt_8 = ConstructPoint(XCoordinate=subtraction, YCoordinate=division_7, ZCoordinate=0)
pt_9 = ConstructPoint(XCoordinate=subtraction, YCoordinate=division_8, ZCoordinate=0)

ln = Line(StartPoint=pt_7, EndPoint=item_15.Item1)
ln_2 = Line(StartPoint=pt_6, EndPoint=pt_7)
ln_3 = Line(StartPoint=item_15.Item1, EndPoint=pt_8)
ln_4 = Line(StartPoint=pt_8, EndPoint=item_15.Item)
ln_5 = Line(StartPoint=item_15.Item, EndPoint=pt_9)
ln_6 = Line(StartPoint=pt_9, EndPoint=pt_5)

# ----
# outter cutting lines
merge_3 = Merge(
    Data1=item_16.Item,
    Data2=item_16.Item1,
    Data3=item_16.Item2,
    Data4=ln_2,
    Data5=ln,
    Data6=ln_3,
    Data7=ln_4,
    Data8=ln_5,
    Data9=ln_6)  # disabled

# ==== cluster ArangeFlatParts: A cluster used to arrange the output of the FlatFab component in Ivy
graph = ClusterInput()  # connect the list of flat graphs from the unroll component
P = ClusterInput()
sx = ClusterInput()
sy = ClusterInput()
rows = ClusterInput()  # the number of rows for the grid
mesh = Mesh(graph)
lng = ListLength(List=mesh)
division = Division(A=lng, B=rows)
cut = ClusterInput()
foldin = ClusterInput()
foldout = ClusterInput()
flat = ClusterInput()
place_holders = ClusterInput()
area = Area(Geometry=mesh)  # -> Area, Centroid
expression = Expression(x=division, Expression="Ceiling(x)")
pshift = ShiftPaths(Data=place_holders, Offset=-1)
pshift_2 = ShiftPaths(Data=cut, Offset=-1)
pshift_3 = ShiftPaths(Data=foldin, Offset=-1)
pshift_4 = ShiftPaths(Data=foldout, Offset=-1)
pshift_5 = ShiftPaths(Data=flat, Offset=-1)
recgrid = Rectangular(Plane=P, SizeX=sx, SizeY=sy, ExtentX=expression, ExtentY=rows)  # -> Cells, flatten(Points)
short = ShortestList(ListA=area.Centroid, ListB=recgrid.Points, TrimMode=2)  # -> ListA, ListB
vec2pt = Vector2Pt(PointA=short.ListA, PointB=short.ListB, Unitize=False)  # -> simplify(graft(Vector)), Length
move = Move(Geometry=graft(mesh), Motion=vec2pt.Vector)  # -> Geometry, Transform
move_2 = Move(Geometry=pshift_2, Motion=vec2pt.Vector)  # -> Geometry, Transform
move_3 = Move(Geometry=pshift_3, Motion=vec2pt.Vector)  # -> Geometry, Transform
move_4 = Move(Geometry=pshift_4, Motion=vec2pt.Vector)  # -> Geometry, Transform
move_5 = Move(Geometry=pshift, Motion=vec2pt.Vector)  # -> Geometry, Transform
move_6 = Move(Geometry=pshift_5, Motion=vec2pt.Vector)  # -> Geometry, Transform
mesh_2 = ClusterOutput(move.Geometry)
cut_2 = ClusterOutput(move_2.Geometry)
foldin_2 = ClusterOutput(move_3.Geometry)
flat_2 = ClusterOutput(move_6.Geometry)
position = ClusterOutput(move_5.Geometry)
foldout_2 = ClusterOutput(move_4.Geometry)
